# Grasshopper definition Banner.gh (Grasshopper 1.0.7)
# plug-ins: ShapeDiverForGrasshopper

rectangle = Rectangle(Plane=PlaneXY(0, 0, 0), XSize=Slider(1584, range=0..10000), YSize=Slider(396, range=0..1000), Radius=0)  # -> Rectangle, Length

# ---- group: SaveAs Image
ghpython_script = GhPythonScript(rectangle=rectangle.Rectangle, capture=Button())  # -> out, a; inputs rectangle: Rectangle3d, capture: Boolean
# ---------- ghpython_script: Python ----------
import Rhino

if capture and rectangle:
    
    sw_point = rectangle.Corner(0)
    ne_point = rectangle.Corner(2)
    cmd = r"_-Print Setup Visibility ViewportArea Window {} {} _Enter Scale ScaleToFit _Enter _Enter Go
# ---------- end ghpython_script ----------

# ----
maxsize = Slider(44, range=0..100)
sddp = ShapeDiverDocumentPayload({AbsoluteTolerance=0, AngleTolerance=0, DistanceDisplayPrecision=0, GltfVersion="Gltf2", GrasshopperVersion="1.0.0007", InputGroups="{}", OutputGroups="{}", RelativeTolerance=0, RhinoVersion="7.37.24107.15001", UnitSystem=0, VersionCreated="1.16.1.0", VersionSaved="1.16.1.0"})
boundaryrectangle = Rectangle({Plane=PlaneXY(792, 198, 0), Size=Domain2(u=-792..792, v=-198..198)})
panel = Panel(boundaryrectangle)
rectangle_2 = Rectangle(Plane=PlaneXY(0, 0, 0), XSize=maxsize, YSize=maxsize, Radius=0)  # -> Rectangle, Length
dimensions = Dimensions(Surface=boundaryrectangle)  # -> UDimension, VDimension
division = Division(A=dimensions.UDimension, B=maxsize)
division_2 = Division(A=dimensions.VDimension, B=maxsize)
rectangular_array = RectangularArray(Geometry=rectangle_2.Rectangle, Cell=rectangle_2.Rectangle, XCount=division, YCount=division_2)  # -> Geometry, Transform
data_dam = DataDam(DataDataA=rectangular_array.Geometry, BufferDelay=10000000, BufferMode=0)
polygongeometries = Geometry()
distancefactor = Slider(1, range=0.5..1)
polygongeometry = Geometry(polygongeometries)
polygon_center = PolygonCenter(Polyline=polygongeometry)  # -> CenterV, CenterE, CenterA
scale = Scale(Geometry=polygongeometry, Center=polygon_center.CenterV, Factor=0.9)  # -> Geometry, Transform
number_slider = Slider(160, range=0..1000)
attractorpoint = Point(Point(480, 0, 0))
xy_plane = XYPlane(Origin=attractorpoint)
maxsize_2 = Number(maxsize)
polygon = Polygon(Plane=attractorpoint, Radius=number_slider, Segments=4, FilletRadius=0)  # -> Polygon, Length
distance = Distance(PointA=attractorpoint, PointB=polygon_center.CenterV)
unit_y = UnitY(Factor=expr("x/4", number_slider))
rotate = Rotate(Geometry=polygon.Polygon, Angle=degrees(Slider(45, range=0..100)), Plane=xy_plane)  # -> Geometry, Transform
division_3 = Division(A=maxsize_2, B=2)
bounds = Bounds(Numbers=distance)
move = Move(Geometry=rotate.Geometry, Motion=unit_y)  # -> Geometry, Transform
remap_numbers = RemapNumbers(Value=distance, Source=bounds, Target=Domain(0.2, 0.75))  # -> Mapped, Clipped
distancefactor_2 = Number(remap_numbers.Mapped)
maxsizefilletfactor = Number(expr("1-x", distancefactor_2))
scalefactor = Number(distancefactor_2)
scale_2 = Scale(Geometry=scale.Geometry, Center=polygon_center.CenterV, Factor=scalefactor)  # -> Geometry, Transform
multiplication = Multiplication(A=division_3, B=maxsizefilletfactor)
panel_2 = Panel(bounds)
fillet = Fillet(Curve=scale_2.Geometry, Radius=multiplication)
boundary_surfaces = BoundarySurfaces(Edges=flatten([boundaryrectangle, fillet]))
boundary_surfaces_2 = BoundarySurfaces(Edges=fillet)
custom_preview = CustomPreview(Geometry=boundary_surfaces_2, Material="#00FFAA")
custom_preview_2 = CustomPreview(Geometry=boundary_surfaces, Material="#242424")
